# Grasshopper definition 07-cnn surrogate in grasshopper.gh (Grasshopper 1.0.8)

path = FilePath("C:\Users\MartinBielik\Dev\SpatialTimber\SpatialTimber_UtilityEval\models\cnn_v4.pt")
path_2 = FilePath("C:\Users\MartinBielik\Dev\SpatialTimber\SpatialTimber_UtilityEval\grasshopper\test_rooms.json")
panel = Panel(path_2)
panel_2 = Panel("""Bedroom
Living room
Bathroom
WC
Kitchen
Children 1
Children 2
Children 3
Children 4""")
panel_3 = Panel("""Studio (bedroom)
Studio (living)
1-Bedroom
2-Bedroom
3-Bedroom
4-Bedroom
5-Bedroom""")
panel_4 = Panel(path)
test_rooms = Script(json_path=path_2)  # -> out, polygons, doors, room_types, apartment_types, names, expected_scores; inputs json_path: String
# ---------- test_rooms: Python ----------
#! python 3
# r: numpy
"""Test room loader — GhPython component for Rhino 8.

Reads test_rooms.json and outputs geometry + metadata as parallel lists,
ready to wire into the surrogate_score component.

Inputs:
    json_path : str — full path to test_rooms.json

Outputs:
    polygons        — room boundary polylines
    doors           — door positions
    room_types      — room type strings
    apartment_types — apartment type strings
    names           — room names for labelling
    expected_scores — expected cnn_v1 scores
"""

import json
import Rhino.Geometry as rg

with open(json_path, "r") as f:
    data = json.load(f)

polygons = []
doors = []
room_types = []
apartment_types = []
names = []
expected_scores = []

for room in data["rooms"]:
    pts = [rg.Point3d(x, y, 0) for x, y in room["polygon"]]
    polygons.append(rg.Polyline(pts))

    dx, dy = room["door"]
    doors.append(rg.Point3d(dx, dy, 0))

    room_types.append(room["room_type"])
    apartment_types.append(room["apartment_type"])
    names.append(room["name"])
    expected_scores.append(room["expected_score"])
# ---------- end test_rooms ----------
number_slider = Slider(2, range=0..7)
room_outline = Curve(<curve referenced from the Rhino model>)
door_pt = Point(Point(6.967754316, 6.026602088, 0))
item = ListItem(List=test_rooms.names, Index=number_slider, Wrap=True)
item_2 = ListItem(List=test_rooms.polygons, Index=number_slider, Wrap=True)
item_3 = ListItem(List=test_rooms.apartment_types, Index=number_slider, Wrap=True)
item_4 = ListItem(List=test_rooms.doors, Index=number_slider, Wrap=True)
item_5 = ListItem(List=test_rooms.expected_scores, Index=number_slider, Wrap=True)
item_6 = ListItem(List=test_rooms.room_types, Index=number_slider, Wrap=True)
item_7 = ListItem(List=panel_3, Index=Slider(2, range=0..6), Wrap=True)
item_8 = ListItem(List=panel_2, Index=Slider(1, range=0..8), Wrap=True)
panel_5 = Panel(test_rooms.apartment_types)
furnisher_surrogate = Script(polygon=item_2, door=item_4, room_type=item_6, apartment_type=item_3, model_path=path)  # -> out, a, score; inputs polygon: Polyline, door: Point3d, room_type: String, apartment_type: String, model_path: String
# ---------- furnisher_surrogate: Python ----------
#! python 3
# r: numpy, Pillow
"""Surrogate score predictor — GhPython component for Rhino 8.

Dependencies auto-installed via ``# r:`` above: numpy, Pillow.
PyTorch CPU and the furnisher_surrogate package must be installed
manually once — see grasshopper/README.md for instructions.

Inputs (set in Grasshopper component):
    polygon : Polyline  — room boundary (closed polyline)
    door    : Point3d   — door position on wall
    room_type : str     — one of: Bedroom, Living room, Bathroom, WC,
                          Kitchen, Children 1-4
    apartment_type : str — one of: Studio (bedroom), Studio (living),
                           1-Bedroom, 2-Bedroom, 3-Bedroom, 4-Bedroom,
                           5-Bedroom
    model_path : str    — (optional) path to .pt checkpoint

Output:
    score : float — predicted furniture placement score (0-100)
"""

import numpy as np
from furnisher_surrogate.predict import predict_score

# Convert Rhino Polyline → numpy (N, 2) array
# polygon is a Rhino Polyline; iterate its points
poly_np = np.array(
    [[pt.X, pt.Y] for pt in polygon],
    dtype=np.float64,
)

# Ensure closed polyline
if not np.allclose(poly_np[0], poly_np[-1]):
    poly_np = np.vstack([poly_np, poly_np[0:1]])

# Convert Rhino Point3d → numpy (2,) array
door_np = np.array([door.X, door.Y], dtype=np.float64)

# Predict
score = predict_score(
    poly_np,
    door_np,
    room_type,
    apartment_type=apartment_type if apartment_type else None,
    model_path=model_path if model_path else None,
)
# ---------- end furnisher_surrogate ----------
furnisher_surrogate_2 = Script(polygon=room_outline, door=door_pt, room_type=item_8, apartment_type=item_7, model_path=path)  # -> out, a, score; inputs polygon: Polyline, door: Point3d, room_type: String, apartment_type: String, model_path: String; same code as furnisher_surrogate
furnisher_surrogate_3 = Script(
    polygon=test_rooms.polygons,
    door=test_rooms.doors,
    room_type=test_rooms.room_types,
    apartment_type=test_rooms.apartment_types,
    model_path=path)  # -> out, a, score; inputs polygon: Polyline, door: Point3d, room_type: String, apartment_type: String, model_path: String; same code as furnisher_surrogate
panel_6 = Panel(item_5)
panel_7 = Panel(furnisher_surrogate.score)
panel_8 = Panel(item)
panel_9 = Panel(item_7)
panel_10 = Panel(furnisher_surrogate_2.score)
panel_11 = Panel(item_8)
panel_12 = Panel(furnisher_surrogate_2.out)
