# Grasshopper definition 08-representation.gh (Grasshopper 1.0.8)

path = FilePath("C:\Users\MartinBielik\Dev\SpatialTimber\SpatialTimber_UtilityEval\tests\fixtures\apartments\hand_crafted.json")
panel = Panel(path)
apartment_reader = Script(json_path=path, index=Slider(1, range=0..10))  # -> out, apt_id, apartment_type, outer_polygon, entrance, outer_is_exterior, room_polygons, room_types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; inputs json_path: String, index: Int32
# ---------- apartment_reader: Python ----------
#! python 3
"""Apartment reader — GhPython component for Rhino 8.

Loads an apartment fixture JSON and reconstructs it as Rhino geometry.
Primary uses:
  - Visually verify hand-crafted fixtures are geometrically correct
  - Inspect Luyang's labeled test apartments before running evaluation

No external package imports — only json (stdlib) and Rhino.Geometry.

Inputs:
    json_path  [Item] str — path to .json file (array of apartments, or single object)
    index      [Item] int — which apartment to load (0-based, default 0)

Outputs:
    apt_id               [Item] str        — the `id` field
    apartment_type       [Item] str        — e.g. "2-Bedroom"
    outer_polygon        [Item] Polyline   — apartment boundary
    entrance             [Item] Point3d    — entrance point on outer wall
    outer_is_exterior    [List] bool       — True = facade, one flag per outer polygon edge
    doors                [List] Point3d    — all interior door openings
    room_polygons        [List] Polyline   — one per room
    room_types           [List] str        — parallel to room_polygons
    expected_daylight    [Item] float|None — from expected_scores.daylight
    expected_circulation [Item] float|None — from expected_scores.circulation
    status               [Item] str        — e.g. "Loaded H01 (2-Bedroom) — 3 rooms, 2 doors"
"""

import json
import Rhino.Geometry as rg

# --- reset outputs ---
apt_id = None
apartment_type = None
outer_polygon = None
entrance = None
outer_is_exterior = []
doors = []
room_polygons = []
room_types = []
expected_daylight = None
expected_circulation = None
status = ""

try:
    # --- load file ---
    try:
        with open(json_path, "r") as f:
            data = json.load(f)
    except IOError:
        status = "ERROR: file not found — {}".format(json_path)
        raise StopIteration

    # normalise to list
    if isinstance(data, dict):
        apartments = [data]
    else:
        apartments = data

    idx = index if index is not None else 0
    if idx < 0 or idx >= len(apartments):
        status = "ERROR: index {} out of range (file has {} apartments)".format(
            idx, len(apartments)
        )
        raise StopIteration

    apt = apartments[idx]

    # --- required top-level fields ---
    for field in ("id", "apartment_type", "entrance", "outer_polygon",
                  "outer_is_exterior", "doors", "rooms"):
        if field not in apt:
            status = "ERROR: missing field '{}'".format(field)
            raise StopIteration

    # --- scalars ---
    apt_id = apt["id"]
    apartment_type = apt["apartment_type"]

    # --- entrance ---
    ex, ey = apt["entrance"]
    entrance = rg.Point3d(ex, ey, 0)

    # --- outer polygon ---
    outer_polygon = rg.Polyline(
        [rg.Point3d(x, y, 0) for x, y in apt["outer_polygon"]]
    )

    # --- outer_is_exterior ---
    outer_is_exterior = list(apt["outer_is_exterior"])

    # --- doors ---
    for dx, dy in apt["doors"]:
        doors.append(rg.Point3d(dx, dy, 0))

    # --- rooms ---
    for room in apt["rooms"]:
        room_types.append(room["room_type"])
        pts = [rg.Point3d(x, y, 0) for x, y in room["polygon"]]
        room_polygons.append(rg.Polyline(pts))

    # --- expected scores ---
    es = apt.get("expected_scores", {})
    expected_daylight = es.get("daylight")
    expected_circulation = es.get("circulation")

    status = "Loaded {} ({}) — {} rooms, {} doors".format(
        apt_id, apartment_type, len(room_polygons), len(doors)
    )

except StopIteration:
    pass
except Exception as e:
    status = "ERROR: {}".format(e)
# ---------- end apartment_reader ----------
# Bedroom
# Living room
# Bathroom
# WC
# Kitchen
# Children 1
# Children 2
# Children 3
# Children 4
panel_2 = Panel("""Studio (bedroom)
Studio (living)
1-Bedroom
2-Bedroom
3-Bedroom
4-Bedroom
5-Bedroom""")
panel_3 = Panel(apartment_reader.apt_id)
panel_4 = Panel(apartment_reader.apartment_type)
outher_polygon_crv = Curve(apartment_reader.outer_polygon)
panel_5 = Panel(apartment_reader.outer_is_exterior)
entrance_pt = Point(apartment_reader.entrance)
room_polygons_crv = Curve(apartment_reader.room_polygons)
panel_6 = Panel(apartment_reader.room_types)
room_door_pt = Point(apartment_reader.doors)
panel_7 = Panel(apartment_reader.expected_daylight)
panel_8 = Panel(apartment_reader.expected_circulation)
panel_9 = Panel(apartment_reader.status)
item = ListItem(List=panel_2, Index=Slider(3, range=0..10), Wrap=True)
panel_10 = Panel("""False
True
False
False""")
panel_11 = Panel("""Hallway
Bathroom
Kitchen
Children 1
Bedroom
Living room""")
panel_12 = Panel(item)
entrance_pt_2 = Point(<point referenced from the Rhino model>)
outline = Curve(<curve referenced from the Rhino model>)
rooms = Curve([<curve referenced from the Rhino model> x6])
doors_pt = Point([<point referenced from the Rhino model> x5])
item_2 = ListItem(List=room_door_pt, Index=Slider(0, range=0..10), Wrap=True)
item_3 = ListItem(List=room_polygons_crv, Index=Slider(0, range=0..10), Wrap=True)
item_4 = ListItem(List=panel_5, Index=Slider(5, range=0..10), Wrap=True)
path_2 = FilePath("C:\Users\MartinBielik\Dev\SpatialTimber\SpatialTimber_UtilityEval\tests\fixtures\apartments\08_write test 2.json")
path_3 = FilePath("C:\Users\MartinBielik\Dev\SpatialTimber\SpatialTimber_UtilityEval\tests\fixtures\apartments\08_write test 1.json")
aprtment_writer = Script(
    apt_id="H06",
    apartment_type=panel_12,
    outer_polygon=outline,
    entrance=entrance_pt_2,
    outer_is_exterior=panel_10,
    room_polygons=rooms,
    room_types=panel_11,
    doors=doors_pt,
    output_path=path_2,
    write=Toggle(False))  # -> out, json_str, status; inputs apt_id: String, apartment_type: String, outer_polygon: Polyline, entrance: Point3d, outer_is_exterior: list of Boolean, room_polygons: list of Polyline, room_types: list of String, doors: list of Point3d, expected_daylight: Double, expected_circulation: Double, output_path: String, write: Boolean
# ---------- aprtment_writer: Python ----------
#! python 3
"""Apartment writer — GhPython component for Rhino 8.

Takes geometry drawn in Rhino and exports a valid apartment fixture JSON.
Primary use: Luyang exports her floor plans from Rhino to the fixture format
expected by the evaluation functions.

No external package imports — only json (stdlib) and Rhino.Geometry.

Inputs:
    apt_id               [Item] str        — unique ID (e.g. "L01")
    apartment_type       [Item] str        — must be one of the 7 APT_TYPES
    outer_polygon        [Item] Polyline   — CCW closed apartment boundary
    entrance             [Item] Point3d    — point on outer wall
    outer_is_exterior    [List] bool       — one flag per outer polygon edge (len == len(outer_polygon) - 1)
    doors                [List] Point3d    — all interior door openings, one Point3d per door
    room_polygons        [List] Polyline   — one per room, CCW closed
    room_types           [List] str        — parallel to room_polygons
    expected_daylight    [Item] float|None — 0–100 or leave empty
    expected_circulation [Item] float|None — 0–100 or leave empty
    output_path          [Item] str        — where to write the JSON
    write                [Item] bool       — toggle/button trigger

Outputs:
    json_str [Item] str — pretty-printed JSON (for preview panel)
    status   [Item] str — "Written to /path/to/file.json" or error message
"""

import json
import Rhino.Geometry as rg

APT_TYPES = [
    "Studio (bedroom)", "Studio (living)", "1-Bedroom",
    "2-Bedroom", "3-Bedroom", "4-Bedroom", "5-Bedroom",
]

ROOM_TYPES = [
    "Bedroom", "Living room", "Bathroom", "WC", "Kitchen",
    "Children 1", "Children 2", "Children 3", "Children 4", "Hallway",
]

# --- reset outputs ---
json_str = ""
status = ""

try:
    # --- validate ---
    errors = []

    if not apt_id:
        errors.append("apt_id is required")

    if apartment_type not in APT_TYPES:
        errors.append("apartment_type '{}' not in APT_TYPES ({})".format(
            apartment_type, ", ".join(APT_TYPES)
        ))

    if outer_polygon is None:
        errors.append("outer_polygon is required")

    if entrance is None:
        errors.append("entrance is required")

    n_outer_edges = (outer_polygon.Count - 1) if outer_polygon is not None else 0
    n_ext_flags = len(outer_is_exterior) if outer_is_exterior else 0
    if outer_polygon is not None and n_ext_flags != n_outer_edges:
        errors.append(
            "outer_is_exterior length ({}) must equal len(outer_polygon) - 1 ({})".format(
                n_ext_flags, n_outer_edges
            )
        )

    if not doors:
        errors.append("doors list is required (at least one door point)")

    n_rooms = len(room_polygons) if room_polygons else 0
    n_types = len(room_types) if room_types else 0
    if n_rooms != n_types:
        errors.append(
            "room_polygons ({}) and room_types ({}) must have equal length".format(
                n_rooms, n_types
            )
        )

    for i, rt in enumerate(room_types or []):
        if rt not in ROOM_TYPES:
            errors.append("room_types[{}] '{}' not in ROOM_TYPES".format(i, rt))

    if errors:
        status = "ERROR: " + "; ".join(errors)
    else:
        def poly_to_list(poly):
            return [[round(pt.X, 4), round(pt.Y, 4)] for pt in poly]

        rooms_data = []
        for poly, rt in zip(room_polygons, room_types):
            rooms_data.append({
                "room_type": rt,
                "polygon": poly_to_list(poly),
            })

        apt_dict = {
            "id": apt_id,
            "apartment_type": apartment_type,
            "entrance": [round(entrance.X, 4), round(entrance.Y, 4)],
            "outer_polygon": poly_to_list(outer_polygon),
            "outer_is_exterior": [bool(f) for f in outer_is_exterior],
            "doors": [[round(d.X, 4), round(d.Y, 4)] for d in doors],
            "rooms": rooms_data,
            "expected_scores": {
                "daylight": expected_daylight if expected_daylight is not None else None,
                "circulation": expected_circulation if expected_circulation is not None else None,
                "furnitability": None,
            },
        }

        json_str = json.dumps([apt_dict], indent=2)

        if write:
            with open(output_path, "w") as f:
                f.write(json_str)
            status = "Written to {}".format(output_path)
        else:
            status = "Preview only (set write=True to save)"

except Exception as e:
    status = "ERROR: {}".format(e)
# ---------- end aprtment_writer ----------
aprtment_writer_2 = Script(
    apt_id=panel_3,
    apartment_type=panel_4,
    outer_polygon=outher_polygon_crv,
    entrance=entrance_pt,
    outer_is_exterior=panel_5,
    room_polygons=room_polygons_crv,
    room_types=panel_6,
    doors=room_door_pt,
    expected_daylight=panel_7,
    expected_circulation=panel_8,
    output_path=path_3,
    write=Toggle(False))  # -> out, json_str, status; inputs apt_id: String, apartment_type: String, outer_polygon: Polyline, entrance: Point3d, outer_is_exterior: list of Boolean, room_polygons: list of Polyline, room_types: list of String, doors: list of Point3d, expected_daylight: Double, expected_circulation: Double, output_path: String, write: Boolean; same code as aprtment_writer
panel_13 = Panel(path_2)
panel_14 = Panel(path_3)
panel_15 = Panel(aprtment_writer_2.json_str)
panel_16 = Panel(aprtment_writer_2.status)
panel_17 = Panel(aprtment_writer.json_str)
panel_18 = Panel(aprtment_writer.status)
pcen = PolygonCenter(Polyline=rooms)  # -> CenterV, CenterE, CenterA
tag = TextTag(Location=pcen.CenterV, Text=panel_11)
tag_2 = TextTag(Location=entrance_pt_2, Text="entrance")
